# Grasshopper definition 01-pose net(get).gh (Grasshopper 1.0.7)
# plug-ins: Runway

# ----
# First Run your Model
# in RunwayML
boolean_toggle = BooleanToggle(False)
# Pars IoCAD
# Runway
# To learn more about RunwayML software visit: www.runwayml.com
# Visit our website to be in touch: www.parsiocad.com
# If you have any coment share it with us on food4rhino.com/app/runway
# This example works with "Pose Net" Model in Runway
# "input http"
# in RunwayML >> Options >> Network >> HTTP >> HTTP Address >> Server Address
panel = Panel("http://localhost:8000")
data_from_runway = DataFromRunway(InputHttp=panel, Run=boolean_toggle)  # -> Data, Info, Error

# ----
# Seperate Alphabets and  Numbers
# "Output Data" is the
# string output of RunwayML
filter_data = FilterData(Data=data_from_runway.Data)  # -> NumberInModel, NameCategory, OutputData
partition_list = PartitionList(List=filter_data.NumberInModel, Size=Slider(2, range=0..10))
number_slider = Slider(10, range=0..10)
list_item = ListItem(List=partition_list, Index=0, Wrap=True)  # -> Item, Item1
multiplication = Multiplication(A=list_item.Item, B=number_slider)
multiplication_2 = Multiplication(A=list_item.Item1, B=number_slider)
construct_point = ConstructPoint(XCoordinate=expr("x*-1", multiplication), YCoordinate=expr("x*-1", multiplication_2), ZCoordinate=0)
