# Grasshopper definition 02- Film-Script-Generator(send & get).gh (Grasshopper 1.0.7)
# plug-ins: Runway

# ---- group: If your input model has several inputs with different types use these components
# To learn more about RunwayML software visit: www.runwayml.com
# Visit our website to be in touch: www.parsiocad.com
# If you have any coment share it with us on food4rhino.com/app/runway
# This example works with "Film-Script-Generator" Model in Runway
# STEP 1
panel = Panel("Just keep practicing the piano,okay?")
number_slider = Slider(74, range=0..100)
# Pars IoCAD
# Runway
panel_2 = Panel("prompt")
number_to_jason = NumberToJason(NumberName="max_characters")
number_to_jason_2 = NumberToJason(NumberName="top_p", Data=Slider(0.1, range=0.1..1))
number_to_jason_3 = NumberToJason(NumberName="seed", Data=Slider(3, range=0..10))
string_to_jason = StringToJason(StringName=panel_2, Data=panel)

# ---- group: Make sure to join different data with ","
# STEP 2
panel_3 = Panel(",")
text_join = TextJoin(Text=[string_to_jason, number_to_jason, number_to_jason_2, number_to_jason_3], Join=panel_3)

# ----
# "input http"
# in RunwayML >> Options >> Network >> HTTP >> HTTP Address >> Server Address
# You can modify timeout to whatever you want
# especially when you have a lot of data
# Connect all your data to this component to convert them to JSON
# First Run your Model
# in RunwayML
# STEP 3
panel_4 = Panel("http://localhost:8000")

json = Json(Data=text_join)
data_to_runway = DataToRunway(HttpAddress=panel_4, Data=json, Timeout=50000, Run=Toggle(False))
# Seperate Alphabets and  Numbers
# "Output Data" is the
# string output of RunwayML
filter_data = FilterData(Data=data_to_runway)  # -> NumberInModel, NameCategory, OutputData
