# Grasshopper definition 03-pix2pix exampel(send & get ).gh (Grasshopper 1.0.7)
# plug-ins: Runway

# ---- group: For sending images to RunwayML use one of this three ways:
# Pars IoCAD
# Runway
# To learn more about RunwayML software visit: www.runwayml.com
# Visit our website to be in touch: www.parsiocad.com
# If you have any coment share it with us on food4rhino.com/app/runway
# This example works with "pix2pix" Model in Runway
# 1) This component take a picture of active view port of Rhino
# Insert saving folder of your images like:
# C:\Users\user\Desktop\New folder (3)
# 2) Select an existing file on your computer
# STEP 1
# 3) Use this component to make your image
#  with pixel  & save your image or modify it
number_slider = Slider(600, range=0..1000)
value_list = ValueList({"jpeg": 0, "png": 1, "tif": 2}, selected="jpeg")
file_path = FilePath()
recompose_image = RecomposeImage(Save=False, FileName="default")
take_a_photo = TakeAPhoto(Width=number_slider, Height=number_slider, FileName="runway", Type=value_list, Reset=Toggle(True))

# ----
# Convert image to Base64
convert_image = ConvertImage(AddressPic=take_a_photo)

# ----
# "String name" need the name of input Model in RunwayML
# STEP 2
panel = Panel("image")
string_to_jason = StringToJason(StringName=panel, Data=convert_image)

# ----
# "input http"
# in RunwayML >> Options >> Network >> HTTP >> HTTP Address >> Server Address
# You can modify timeout to whatever you want
# especially when you have a lot of data
# Connect all your data to this component to convert them to JSON
# First Run your Model
# in RunwayML
# STEP 3
panel_2 = Panel("http://localhost:8000")

json = Json(Data=string_to_jason)
data_to_runway = DataToRunway(HttpAddress=panel_2, Data=json, Timeout=50000, Run=Toggle(False))

# ----
# You can see the image output of RunwayML
# and use the relevant data for images
# Size of this component is
# related to the size of image in RunwayML
# STEP 4
number_slider_2 = Slider(50, range=0..100)
show_image = ShowImage()
decompose_image = DecomposeImage(Data=data_to_runway, Run=Toggle(False), WidthOptional=number_slider_2, HeightOptional=number_slider_2)  # -> Color, BlackWhite, Red, Green, Blue, Alpha
