# Grasshopper definition 04- send data to gan(send & get).gh (Grasshopper 1.0.7)
# plug-ins: Runway

# Pars IoCAD
# Runway
# To learn more about RunwayML software visit: www.runwayml.com
# Visit our website to be in touch: www.parsiocad.com
# If you have any coment share it with us on food4rhino.com/app/runway
# This example works with "CMU-BuildingGenerator" Model in Runway
number_slider = Slider(0, range=0..100)
construct_domain = ConstructDomain(DomainStart=number_slider, DomainEnd=Slider(1, range=0..1))
random = Random(Range=construct_domain, Number=Slider(512, range=0..1000), Seed=Slider(3, range=0..10))  # -> flatten(Random)

# ---- group: If your input model has Array Data with different types use these components
# STEP 1
number_to_jason = NumberToJason(NumberName="truncation", Data=Slider(0.5, range=0.1..0.9))
array_to_json = ArrayToJson(ArrayName="z", Data=random)

# ---- group: Make sure to join different data with ","
# STEP 2
panel = Panel(",")
text_join = TextJoin(Text=[array_to_json, number_to_jason], Join=panel)

# ----
# "input http"
# in RunwayML >> Options >> Network >> HTTP >> HTTP Address >> Server Address
# You can modify timeout to whatever you want
# especially when you have a lot of data
# Connect all your data to this component to convert them to JSON
# First Run your Model
# in RunwayML
# STEP 3
panel_2 = Panel("http://localhost:8000")

json = Json(Data=text_join)
data_to_runway = DataToRunway(HttpAddress=panel_2, Data=json, Timeout=50000, Run=Toggle(False))

# ----
# You can see the image output of RunwayML
# and use the relevant data for images
# Size of this component is
# related to the size of image in RunwayML
# Use this component to see your image
# save your image or modify it
show_image = ShowImage()
number_slider_2 = Slider(50, range=0..100)
recompose_image = RecomposeImage(Save=False, FileName="default")
decompose_image = DecomposeImage(Data=data_to_runway, Run=Toggle(False), WidthOptional=number_slider_2, HeightOptional=number_slider_2)  # -> Color, BlackWhite, Red, Green, Blue, Alpha
